# Dynamo graph scheduZilla.dyn (Dynamo 2.0.1.5055)

# group: Retrieval of Excel Input Data
file_path = Filename(".\Schedule.xlsx")  # graph input
fromPath = FileObject(path=file_path)  # "File.FromPath"
string = StringInput("Data Input")  # graph input
boolean = BoolSelector(true)  # graph input
boolean_2 = BoolSelector(false)
importExcel = Data.ImportExcel(file=fromPath, sheetName=string, readAsStrings=boolean, showExcel=boolean_2)
watch = Watch(importExcel)

# group: Get Family Type
# note: Select Family type you want parameters from
family_types = FamilyTypes(index=0)  # graph input
all_elements_of_family_type = ElementsOfFamilyType(Family_Type=family_types)

# group: Process Data
name = FamilyType.Name(familyType=all_elements_of_family_type)
create = List.Create(item0=name)
watch_2 = Watch(create)

# group: Process Data
# note: String selects Parameter to match to corresponding Excel column
string_2 = StringInput("Host")  # graph input
getParameterValueByName = Element.GetParameterValueByName(element=all_elements_of_family_type, parameterName=string_2)
create_2 = List.Create(item0=getParameterValueByName)
watch_3 = Watch(create_2)

# group: Process Data
string_3 = StringInput("COBie.Type.NominalWidth")  # graph input
getParameterValueByName_2 = Element.GetParameterValueByName(element=all_elements_of_family_type, parameterName=string_3)
create_3 = List.Create(item0=getParameterValueByName_2)
watch_4 = Watch(create_3)

# group: Process Data
string_4 = StringInput("COBie.Type.NominalLength")  # graph input
getParameterValueByName_3 = Element.GetParameterValueByName(element=all_elements_of_family_type, parameterName=string_4)
create_4 = List.Create(item0=getParameterValueByName_3)
watch_5 = Watch(create_4)

# group: Process Data
string_5 = StringInput("COBie.Type.NominalHeight")  # graph input
getParameterValueByName_4 = Element.GetParameterValueByName(element=all_elements_of_family_type, parameterName=string_5)
list_create = List.Create(item0=getParameterValueByName_4)
watch_6 = Watch(list_create)

# group: Process Data
code_block = CodeBlock { 2; }
# note: Bracnch more Excel input nodes from here. Lists will be transposed and Code block selector will assign to correct Excel column.
dropItems = List.DropItems(list=importExcel, amount=code_block)
transpose = List.Transpose(lists=dropItems)
transpose_2 = List.Transpose(lists=dropItems)

# group: Select Parameters to match to Excel Input
code_block_2 = CodeBlock { "ID"; }
code_block_3 = CodeBlock { 0; }
getItemAtIndex = List.GetItemAtIndex(list=transpose, index=code_block_3)
setParameterByName = Element.SetParameterByName(element=all_elements_of_family_type, parameterName=code_block_2, value=getItemAtIndex)
code_block_4 = CodeBlock { "Identity_Reference"; }
code_block_5 = CodeBlock { 1; }
getItemAtIndex_2 = List.GetItemAtIndex(list=transpose_2, index=code_block_5)
setParameterByName_2 = Element.SetParameterByName(element=all_elements_of_family_type, parameterName=code_block_4, value=getItemAtIndex_2)

# group: Process Data
string_6 = StringInput("ID")  # graph input
getParameterValueByName_5 = Element.GetParameterValueByName(element=setParameterByName, parameterName=string_6)
list_create_2 = List.Create(item0=getParameterValueByName_5)
watch_7 = Watch(list_create_2)

# group: Process Data
string_7 = StringInput("Identity_Reference")  # graph input
getParameterValueByName_6 = Element.GetParameterValueByName(element=setParameterByName_2, parameterName=string_7)
list_create_3 = List.Create(item0=getParameterValueByName_6)
watch_8 = Watch(list_create_3)

# group: Write combined lists to Excel
file_path_2 = Filename(".\Schedule.xlsx")  # graph input
string_8 = StringInput("Schedule Output")  # graph input
number = DoubleInput(2)  # graph input
number_2 = DoubleInput(0)  # graph input
join = List.Join(list0=watch_2, list1=watch_3, list2=watch_4, list3=watch_5, list4=watch_6, list5=watch_7, list6=watch_8)
transpose_3 = List.Transpose(lists=join)
boolean_3 = BoolSelector(false)  # graph input
exportExcel = Data.ExportExcel(filePath=file_path_2, sheetName=string_8, startRow=number, startCol=number_2, data=transpose_3, overWrite=boolean_3)
